# Grasshopper definition gh.gh (Grasshopper 1.0.8)
# plug-ins: MeshEdit Components, treesloth01, Pufferfish, BlueOrange, eleFront, HeavyGeoAnalyzer, Flexibility

reflay = ReferenceByLayer(LayerName="in", lightweight=False, DisableAutoUpdate=False)
reflay_2 = ReferenceByLayer(LayerName="out", lightweight=False, DisableAutoUpdate=False)
reflay_3 = ReferenceByLayer(LayerName="door", lightweight=False, DisableAutoUpdate=False)
reflay_4 = ReferenceByLayer(LayerName="win", lightweight=False, DisableAutoUpdate=False)
reflay_5 = ReferenceByLayer(LayerName="FLAT-SP", lightweight=False, DisableAutoUpdate=False)
crv = Curve(reflay_2)
crv_2 = Curve(reflay)
crv_3 = Curve(crv)
boundary = BoundarySurfaces(Edges=crv_3)
pt = Point(<point referenced from the Rhino model>)
srfsplit = SurfaceSplit(Surface=boundary, Curves=crv_2)
bounding_rec = BoundingRectangle(Content=graft(srfsplit), Plane=pt)
boundary_2 = BoundarySurfaces(Edges=bounding_rec)
Z = UnitZ(Factor=Slider(3, range=0..10000))
extr = Extrude(Base=boundary_2, Direction=Z)  # -> flatten(Extrusion)
brep = Brep(extr)
pt_2 = Point(reflay_3)
brep_2 = Brep(brep)
pt_3 = Point(pt_2)
pt_4 = Point(reflay_4)
heavygeo = HeavyGeometryFinder(Run=Toggle(True), TopN=Slider(2, range=0..10), Select=True, Zoom=False)  # -> Geometry, Weight, Type, Layer, Name, Id, Report
debrep = DeconstructBrep(Brep=brep_2)  # -> flatten(Faces), Edges, Vertices
brep_3 = Brep(brep)
crv_4 = Curve(crv)
crv_5 = Curve(reflay_5)
pt_5 = Point(pt_4)
geo = Geometry(heavygeo.Geometry)
Z_2 = UnitZ(Factor=Slider(1, range=0..1000))
debrep_2 = DeconstructBrep(Brep=brep_3)  # -> flatten(Faces), Edges, Vertices
boundary_3 = BoundarySurfaces(Edges=crv_4)
move = Move(Geometry=pt_3, Motion=Z_2)  # -> Geometry, Transform
Z_3 = UnitZ(Factor=Slider(1, range=0..1000))
srfsplit_2 = SurfaceSplit(Surface=boundary_3, Curves=crv_5)
pull = PullPoint(Point=move.Geometry, Geometry=debrep.Faces, ClosestOnly=True)  # -> ClosestPoint, Distance, Index
area = Area(Geometry=srfsplit_2)  # -> Area, Centroid
move_2 = Move(Geometry=pt_5, Motion=Z_3)  # -> Geometry, Transform
neg = Negative(Value=Slider(1, range=0..10))
scale = Scale(Geometry=srfsplit_2, Center=area.Centroid, Factor=Slider(0.99, range=0..1))  # -> Geometry, Transform
item = ListItem(List=debrep.Faces, Index=pull.Index, Wrap=True)
Z_4 = UnitZ(Factor=neg)
pull_2 = PullPoint(Point=move_2.Geometry, Geometry=debrep_2.Faces, ClosestOnly=True)  # -> ClosestPoint, Distance, Index
planar = IsPlanar(Surface=item, Interior=True)  # -> Planar, Plane
edges = BrepEdges(Brep=scale.Geometry)  # -> Naked, Interior, NonManifold
neg_2 = Negative(Value=Slider(1, range=0..10))
item_2 = ListItem(List=debrep_2.Faces, Index=pull_2.Index, Wrap=True)
move2pt = MoveToPoint(Geometry=planar.Plane, PointA=planar.Plane, PointB=move.Geometry)  # -> Moved, Vector, Transform
Z_5 = UnitZ(Factor=neg_2)
neg_3 = Negative(Value=Slider(0.6, range=0..10))
planar_2 = IsPlanar(Surface=item_2, Interior=True)  # -> Planar, Plane
join = JoinCurves(Curves=edges.Naked, Preserve=False)
neg_4 = Negative(Value=Slider(0.2, range=0..1))
Z_6 = UnitZ(Factor=neg_3)
move_3 = Move(Geometry=move2pt.Moved, Motion=Z_4)  # -> Geometry, Transform
move2pt_2 = MoveToPoint(Geometry=planar_2.Plane, PointA=planar_2.Plane, PointB=move_2.Geometry)  # -> Moved, Vector, Transform
offset = OffsetCurve(Curve=join, Distance=neg_4, Corners=1)
number_slider = Slider(1, range=0..10)
number_slider_2 = Slider(1.263, range=0..10)
move_4 = Move(Geometry=move2pt_2.Moved, Motion=Z_6)  # -> Geometry, Transform
boundary_4 = BoundarySurfaces(Edges=offset)
move_5 = Move(Geometry=move2pt.Moved, Motion=Z_5)  # -> Geometry, Transform
neg_5 = Negative(Value=number_slider_2)
planesrf = PlaneSurface(Plane=move_3.Geometry, XSize=Slider(2, range=0..1000), YSize=number_slider)
Z_7 = UnitZ(Factor=Slider(0.1, range=0..0.1))
brep_4 = Brep(graft(brep_2))
dom = ConstructDomain(DomainStart=number_slider_2, DomainEnd=neg_5)
move_6 = Move(Geometry=planesrf, Motion=Z_7)  # -> Geometry, Transform
Z_8 = UnitZ(Factor=Slider(3, range=0..10000))
planesrf_2 = PlaneSurface(Plane=move_5.Geometry, XSize=Slider(2, range=0..1000), YSize=number_slider)
planesrf_3 = PlaneSurface(Plane=move_4.Geometry, XSize=Slider(2, range=0..1000), YSize=dom)
extr_2 = Extrude(Base=boundary_4, Direction=Z_8)  # -> flatten(Extrusion)
fmerge = MergeFaces(Brep=brep_4)  # -> Breps, Before, After
cache = ContentCache(Content=brep_4)
scale_nu = ScaleNU(Geometry=extr_2, Plane=PlaneXY(0, 0, 0), ScaleX=1, ScaleY=1, ScaleZ=Slider(0.4, range=0..10))  # -> Geometry, Transform
smesh = SimpleMesh(Brep=planesrf_2)
smesh_2 = SimpleMesh(Brep=planesrf_3)
brep_5 = Brep(scale_nu.Geometry)
cache_2 = ContentCache(Content=smesh_2)
smesh_3 = SimpleMesh(Brep=move_6.Geometry)
brep_6 = Brep(flatten(fmerge.Breps))
clustering = Python3Script(small_breps=brep_6, big_breps=brep_5)  # -> out, clustered, indices, unmatched; inputs small_breps: list of Brep, big_breps: list
# ---------- clustering: Python ----------
import Rhino
import Rhino.Geometry as rg
import System
import traceback
import scriptcontext as sc
import ghpythonlib.treehelpers as th
from Grasshopper import DataTree
from Grasshopper.Kernel.Data import GH_Path

clustered = DataTree[object]()
indices = DataTree[object]()
unmatched = []

try:
    rhino_doc = Rhino.RhinoDoc.ActiveDoc
    tol = rhino_doc.ModelAbsoluteTolerance

    def to_brep(item):
        if item is None:
            return None
        # Unwrap GH Goo wrappers
        if hasattr(item, "Value"):
            item = item.Value
            if item is None:
                return None
        if isinstance(item, rg.Brep):
            return item
        if isinstance(item, rg.Extrusion):
            return item.ToBrep()
        if isinstance(item, rg.Surface):
            return item.ToBrep()
        if isinstance(item, rg.SubD):
            return rg.Brep.CreateFromSubD(item, 0)
        if isinstance(item, rg.Mesh):
            try:
                return rg.Brep.CreateFromMesh(item, True)
            except:
                return None
        if isinstance(item, System.Guid):
            # Try Rhino doc first
            obj = rhino_doc.Objects.FindId(item)
            if obj is not None and obj.Geometry is not None:
                return to_brep(obj.Geometry)
            # Fallback: try sticky / GH context
            try:
                if hasattr(sc, "doc") and sc.doc is not None:
                    o = sc.doc.Objects.FindId(item)
                    if o is not None and o.Geometry is not None:
                        return to_brep(o.Geometry)
            except:
                pass
            return None
        return None

    def as_list(x):
        if x is None:
            return []
        if isinstance(x, (list, tuple)):
            return list(x)
        try:
            return [v for v in x]
        except TypeError:
            return [x]

    def small_inside_big(small, big, big_bbox):
        small_bbox = small.GetBoundingBox(True)
        if not rg.BoundingBox.Intersection(big_bbox, small_bbox).IsValid:
            return False
        vmp = rg.VolumeMassProperties.Compute(small)
        c = vmp.Centroid if vmp is not None else small_bbox.Center
        try:
            if big.IsSolid and big.IsPointInside(c, tol, True):
                return True
        except Exception:
            pass
        if big_bbox.Contains(c):
            return True
        try:
            ok, curves, points = rg.Intersect.Intersection.BrepBrep(small, big, tol)
            if ok and (curves.Length > 0 or points.Length > 0):
                return True
        except Exception:
            pass
        return False

    big_raw = as_list(big_breps)
    small_raw = as_list(small_breps)

    print("Inputs - big: {}, small: {}".format(len(big_raw), len(small_raw)))

    big_list = [b for b in (to_brep(x) for x in big_raw) if b is not None]
    small_list = [s for s in (to_brep(x) for x in small_raw) if s is not None]

    print("Converted - big: {}, small: {}".format(len(big_list), len(small_list)))

    if len(big_list) == 0 and len(big_raw) > 0:
        print(">>> CANNOT RESOLVE big_breps Guids. PLEASE SET INPUT TYPE HINT TO 'Brep'")
        print(">>> Right-click the 'big_breps' input parameter -> Type hint -> Brep")

    matched = set()
    for i, big in enumerate(big_list):
        path = GH_Path(i)
        big_bbox = big.GetBoundingBox(True)
        for j, small in enumerate(small_list):
            if small_inside_big(small, big, big_bbox):
                clustered.Add(small, path)
                indices.Add(j, path)
                matched.add(j)

    for j, small in enumerate(small_list):
        if j not in matched:
            unmatched.append(small)

    print("Matched: {}, Unmatched: {}".format(len(matched), len(unmatched)))
    print("Branches: {}".format(clustered.BranchCount))

except Exception as e:
    print("EXCEPTION:", str(e))
    print(traceback.format_exc())
# ---------- end clustering ----------
cache_3 = ContentCache(Content=smesh)
brep_7 = Brep(clustering.clustered)
tstat = TreeStatistics(Tree=clustering.clustered)  # -> Paths, Length, Count
bbox = BoundingBox(Content=brep_7, Plane=PlaneXY(0, 0, 0))  # -> Box, Box_2
smesh_4 = SimpleMesh(Brep=bbox.Box)
cache_4 = ContentCache(Content=smesh_3)
preview = CustomPreview(Geometry=brep_6, Material=ColourSwatch(SwatchColor=RGBA(235, 26, 26, 74)))
unweave = Unweave()  # -> Data0, Data1
colors = Python3Script(count=tstat.Count, seed=Slider(4, range=0..10))  # -> out, colors; inputs seed: Int32
# ---------- colors: Python ----------
import System.Drawing as sd
import colorsys

def hsl_to_color(h, s, l):
    r, g, b = colorsys.hls_to_rgb(h, l, s)
    return sd.Color.FromArgb(255, int(r * 255), int(g * 255), int(b * 255))

n = max(1, int(count) if count is not None else 1)
s_offset = (int(seed) if seed is not None else 0) * 0.137

# Golden ratio conjugate — guarantees maximum hue separation
phi = 0.6180339887

colors = []
for i in range(n):
    h = (i * phi + s_offset) % 1.0
    # Alternate saturation and lightness slightly so even similar hues differ
    if i % 3 == 0:
        s, l = 0.85, 0.55
    elif i % 3 == 1:
        s, l = 0.95, 0.45
    else:
        s, l = 0.75, 0.65
    colors.append(hsl_to_color(h, s, l))
# ---------- end colors ----------
object = ModelObject(Object=smesh_4, Display=graft(colors.colors))  # -> Object, Geometry, Name, Layer, Visibility, Display, Drafting, Render
text = TextOutlines(
    Text="""YourText
 in field""",
    Size=2.55,
    Style=2,
    Plane=PlaneXY(0, 0, 0),
    Justification=4,
    Small=1,
    Spacing=0,
    Underline=False,
    Union=False,
    Fix=True)  # -> Curve, Text, Extrusion
panel = Panel(clustering.clustered)
brep_8 = Brep(graft(<brep referenced from the Rhino model>))
brep_9 = Brep(<brep referenced from the Rhino model>)
preview_2 = CustomPreview(Geometry=clustering.clustered, Material=graft(colors.colors))
rhatt = GetRhinoAttributes(Geometry=brep_8, fullpath=False)  # -> Name, Layer, Color, MaterialName, SourceFile
bereb_to_mesh = CSharpScript(B=brep_8)  # -> out, Mesh; inputs B: Brep
# ---------- bereb_to_mesh: C# ----------
using System;
using System.Collections.Generic;
using System.Linq;
using Rhino;
using Rhino.Geometry;

if (B == null) { Mesh = null; return; }

var mesh = new Rhino.Geometry.Mesh();

// Brep vertex -> Mesh vertex (1:1)
int[] vmap = new int[B.Vertices.Count];
for (int i = 0; i < B.Vertices.Count; i++)
    vmap[i] = mesh.Vertices.Add(B.Vertices[i].Location);

foreach (var face in B.Faces)
{
    var outer = face.OuterLoop;
    if (outer == null) continue;

    var corners = new List<int>();
    var pts = new List<Point3d>();

    foreach (var trim in outer.Trims)
    {
        var edge = trim.Edge;
        if (edge == null) continue;
        var sv = trim.IsReversed() ? edge.EndVertex : edge.StartVertex;
        int mv = vmap[sv.VertexIndex];
        if (corners.Count == 0 || corners[corners.Count - 1] != mv)
        {
            corners.Add(mv);
            pts.Add(B.Vertices[sv.VertexIndex].Location);
        }
    }
    if (corners.Count > 1 && corners[0] == corners[corners.Count - 1])
    {
        corners.RemoveAt(corners.Count - 1);
        pts.RemoveAt(pts.Count - 1);
    }
    if (face.OrientationIsReversed) { corners.Reverse(); pts.Reverse(); }

    int n = corners.Count;
    if (n < 3) continue;

    if (n == 3)
        mesh.Faces.AddFace(corners[0], corners[1], corners[2]);
    else if (n == 4)
        mesh.Faces.AddFace(corners[0], corners[1], corners[2], corners[3]);
    else
    {
        // Project to 2D plane of the face
        Plane.FitPlaneToPoints(pts, out Plane plane);
        var p2 = new Point2d[n];
        for (int i = 0; i < n; i++)
        {
            plane.RemapToPlaneSpace(pts[i], out Point3d local);
            p2[i] = new Point2d(local.X, local.Y);
        }
        double sa = 0;
        for (int i = 0; i < n; i++)
        {
            var p = p2[i]; var q = p2[(i + 1) % n];
            sa += p.X * q.Y - q.X * p.Y;
        }
        bool ccw = sa > 0;

        var faceIds = new List<int>();
        var idx = Enumerable.Range(0, n).ToList();
        int guard = n * 4;

        while (idx.Count > 4 && guard-- > 0)
        {
            bool clipped = false;

            // Quad ear preference
            for (int i = 0; i < idx.Count; i++)
            {
                int a = idx[i];
                int b = idx[(i + 1) % idx.Count];
                int c = idx[(i + 2) % idx.Count];
                int d = idx[(i + 3) % idx.Count];

                if (IsConvexQuad(p2[a], p2[b], p2[c], p2[d], ccw) &&
                    QuadIsClear(idx, a, b, c, d, p2))
                {
                    faceIds.Add(mesh.Faces.AddFace(corners[a], corners[b], corners[c], corners[d]));
                    int iB = (i + 1) % idx.Count;
                    int iC = (i + 2) % idx.Count;
                    if (iC > iB) { idx.RemoveAt(iC); idx.RemoveAt(iB); }
                    else { idx.RemoveAt(iB); idx.RemoveAt(iC); }
                    clipped = true;
                    break;
                }
            }
            if (clipped) continue;

            // Triangle ear fallback
            for (int i = 0; i < idx.Count; i++)
            {
                int a = idx[(i - 1 + idx.Count) % idx.Count];
                int b = idx[i];
                int c = idx[(i + 1) % idx.Count];

                if (IsConvexTri(p2[a], p2[b], p2[c], ccw) &&
                    TriIsClear(idx, a, b, c, p2))
                {
                    faceIds.Add(mesh.Faces.AddFace(corners[a], corners[b], corners[c]));
                    idx.RemoveAt(i);
                    clipped = true;
                    break;
                }
            }
            if (!clipped) break;
        }

        if (idx.Count == 4)
            faceIds.Add(mesh.Faces.AddFace(corners[idx[0]], corners[idx[1]], corners[idx[2]], corners[idx[3]]));
        else if (idx.Count == 3)
            faceIds.Add(mesh.Faces.AddFace(corners[idx[0]], corners[idx[1]], corners[idx[2]]));

        mesh.Ngons.AddNgon(Rhino.Geometry.MeshNgon.Create(corners, faceIds));
    }
}

mesh.RebuildNormals();
mesh.Compact();
Mesh = mesh;

// ---- helpers ----
double Cross2D(Point2d a, Point2d b, Point2d c) =>
    (b.X - a.X) * (c.Y - a.Y) - (b.Y - a.Y) * (c.X - a.X);

bool IsConvexTri(Point2d a, Point2d b, Point2d c, bool ccw)
{
    double cr = Cross2D(a, b, c);
    return ccw ? cr > 1e-9 : cr < -1e-9;
}

bool IsConvexQuad(Point2d a, Point2d b, Point2d c, Point2d d, bool ccw) =>
    IsConvexTri(a, b, c, ccw) && IsConvexTri(b, c, d, ccw) &&
    IsConvexTri(c, d, a, ccw) && IsConvexTri(d, a, b, ccw);

bool PointInTri(Point2d p, Point2d a, Point2d b, Point2d c)
{
    double d1 = Cross2D(a, b, p);
    double d2 = Cross2D(b, c, p);
    double d3 = Cross2D(c, a, p);
    bool neg = d1 < 0 || d2 < 0 || d3 < 0;
    bool pos = d1 > 0 || d2 > 0 || d3 > 0;
    return !(neg && pos);
}

bool TriIsClear(List<int> idx, int a, int b, int c, Point2d[] pts)
{
    foreach (int k in idx)
        if (k != a && k != b && k != c && PointInTri(pts[k], pts[a], pts[b], pts[c]))
            return false;
    return true;
}

bool QuadIsClear(List<int> idx, int a, int b, int c, int d, Point2d[] pts)
{
    foreach (int k in idx)
    {
        if (k == a || k == b || k == c || k == d) continue;
        if (PointInTri(pts[k], pts[a], pts[b], pts[c]) ||
            PointInTri(pts[k], pts[a], pts[c], pts[d])) return false;
    }
    return true;
}
# ---------- end bereb_to_mesh ----------
geo_2 = Geometry(graft(<mesh referenced from the Rhino model>))
geo_3 = Geometry(graft(<mesh referenced from the Rhino model>))
brep_10 = Brep(<brep referenced from the Rhino model>)
unweld = UnweldMesh(Mesh=graft(bereb_to_mesh.Mesh), Angle=1.570796327)
bereb_to_mesh_2 = CSharpScript(B=brep_10)  # -> out, Mesh; inputs B: Brep; same code as bereb_to_mesh
mesh = Mesh([<mesh referenced from the Rhino model> x123])
object_2 = ModelObject(Object=unweld, Name=rhatt.Name)  # -> Object, Geometry, Name, Layer, Visibility, Display, Drafting, Render
cache_5 = ContentCache(Content=object.Object)
cache_6 = ContentCache()
rhatt_2 = GetRhinoAttributes(Geometry=mesh, fullpath=False)  # -> Name, Layer, Color, MaterialName, SourceFile
detatt = DetachAttributes(Geometry=mesh)  # -> Geometry, Attributes
volume = MeshVolume(Mesh=mesh)  # -> Volume, Centroid
cache_7 = ContentCache(Content=bereb_to_mesh_2.Mesh)
cache_8 = ContentCache(Content=object_2.Object)
cache_9 = ContentCache(Content=object_2.Object)
tag = TextTag(Location=volume.Centroid, Text=rhatt_2.Name)
brep_11 = Brep(<brep referenced from the Rhino model>)
brep_12 = Brep(<brep referenced from the Rhino model>)
unweld_2 = UnweldMesh(Angle=1.570796327)
bereb_to_mesh_3 = CSharpScript(B=brep_11)  # -> out, Mesh; inputs B: Brep; same code as bereb_to_mesh
bereb_to_mesh_4 = CSharpScript(B=brep_12)  # -> out, Mesh; inputs B: Brep; same code as bereb_to_mesh
weldvertices = MeshWeldVertices(Mesh=<geometry referenced from the Rhino model>, Tolerance=0.01)  # -> RuntimeMessage, Mesh
cache_10 = ContentCache(Content=bereb_to_mesh_3.Mesh)
cache_11 = ContentCache(Content=bereb_to_mesh_4.Mesh)
weld = WeldMesh(Mesh=<geometry referenced from the Rhino model>, Angle=3.141592654)
